# Grasshopper definition function_colours.gh (Grasshopper 1.0.8)
# plug-ins: ColorPlus, Telepathy

number_slider = Slider(100, range=0..100)
rectangle = Rectangle(Plane=PlaneXY(0, 0, 0), XSize=number_slider, YSize=number_slider, Radius=0)  # -> Rectangle, Length
division = Division(A=number_slider, B=Slider(14, range=1..20))
arrrec = RectangularArray(Geometry=rectangle.Rectangle, Cell=rectangle.Rectangle, XCount="10", YCount="3")  # -> reverse(Geometry), Transform
as_text = AnnotationTextSettings(TextHeight=division, HorizontalAlignment=1, VerticalAlignment=3)
# function colors
qltype = QLtype()
jagged = SettingsSpeed()
# Cyan
number_slider_2 = Slider(2, range=0..10)
# Yellow
number_slider_3 = Slider(2, range=0..10)
# Grey
number_slider_4 = Slider(2, range=0..10)
# Red
number_slider_5 = Slider(2, range=0..10)
C = Slider(1, range=0..3)
C_2 = Slider(3, range=0..3)
C_3 = Slider(1, range=0..3)
C_4 = Slider(2, range=0..3)
wheel = ColourWheel(
    number_slider_2,
    ColourGrips_Style=10,
    ColourGrips_Grip=[3.248776505, 0.5624644724, 2.656859575, 3.141592654],
    ColourGrips_Lum=[0.7508483486, 0.9346609831],
    ColourGrips_Range=[0.0006942254255, 0.0006942254255, 0.0006942254255, 0.0006942254255],
    ColourGrips_Sat=[1, 1])
wheel_2 = ColourWheel(
    number_slider_5,
    ColourGrips_Style=10,
    ColourGrips_Grip=[0.03743614243, 0.5624644724, 2.656859575, 3.141592654],
    ColourGrips_Lum=[0.5027658817, 0.9249913599],
    ColourGrips_Range=[0.205306413, 0.205306413, 0.205306413, 0.205306413],
    ColourGrips_Sat=[0.6725125887, 0.9000017405])
wheel_3 = ColourWheel(
    number_slider_3,
    ColourGrips_Style=10,
    ColourGrips_Grip=[0.9597851393, 0.5624644724, 2.656859575, 3.141592654],
    ColourGrips_Lum=[0.3706507022, 0.9305283008],
    ColourGrips_Range=[0.4723153349, 0.4723153349, 0.4723153349, 0.4723153349],
    ColourGrips_Sat=[1, 1])
wheel_4 = ColourWheel(
    number_slider_4,
    ColourGrips_Style=10,
    ColourGrips_Grip=[6.169762797, 0.5624644724, 2.656859575, 3.141592654],
    ColourGrips_Lum=[0.4725083951, 0.8938427619],
    ColourGrips_Range=[0.205306413, 0.205306413, 0.205306413, 0.205306413],
    ColourGrips_Sat=[0, 0])
cluster = Cluster_3(N="Yellow", A=C_2)
cluster_2 = Cluster_3(N="Red", A=C_4)
cluster_3 = Cluster_3(N="Cyan", A=C)
cluster_4 = Cluster(C=C_2)
cluster_5 = Cluster_3(N="Grey", A=C_3)
cluster_6 = Cluster(C=C)
cluster_7 = Cluster(C=C_4)
cluster_8 = Cluster(C=C_3)
constgrad = ConstructGradient(Colors=wheel_3, Sample=cluster_4, InterpolationMode=0)
cluster_9 = Cluster_2(N=cluster, kd=constgrad)
constgrad_2 = ConstructGradient(Colors=wheel, Sample=cluster_6, InterpolationMode=0)
cluster_10 = Cluster_2(N=cluster_3, kd=constgrad_2)
constgrad_3 = ConstructGradient(Colors=wheel_2, Sample=cluster_7, InterpolationMode=0)
cluster_11 = Cluster_2(N=cluster_2, kd=constgrad_3)
constgrad_4 = ConstructGradient(Colors=wheel_4, Sample=cluster_8, InterpolationMode=0)
cluster_12 = Cluster_2(N=cluster_5, kd=constgrad_4)
item = ListItem(List=cluster_9, Index=0, Wrap=True)  # -> Item, Item1, Item2, Item3
item_2 = ListItem(List=cluster_11, Index=0, Wrap=True)  # -> Item, Item1, Item2
item_3 = ListItem(List=cluster_10, Index=0, Wrap=True)  # -> Item, Item1
item_4 = ListItem(List=cluster_12, Index=0, Wrap=True)  # -> Item, Item1, Item2
prevclr = PreviewColors(Colors=constgrad, Height=100, Label=False, Width=200)
prevclr_2 = PreviewColors(Colors=constgrad_3, Height=100, Label=False, Width=200)
prevclr_3 = PreviewColors(Colors=constgrad_4, Height=100, Label=False, Width=200)
prevclr_4 = PreviewColors(Colors=constgrad_2, Height=100, Label=False, Width=200)
information = ContentInformation(Content=item.Item3, Tags="single")
information_2 = ContentInformation(Content=item_2.Item2, Notes=ColourSwatch(SwatchColor=RGB(209, 209, 209)), Tags="emergency")
information_3 = ContentInformation(Content=item.Item, Tags="daycare")
information_4 = ContentInformation(Content=item.Item1, Tags="ward")
information_5 = ContentInformation(Content=item_2.Item, Tags="lab")
information_6 = ContentInformation(Content=item_2.Item1, Tags="icu")
information_7 = ContentInformation(Content=item.Item2, Tags="twin")
information_8 = ContentInformation(Content=item_3.Item, Tags="public")
information_9 = ContentInformation(Content=item_3.Item1, Tags="corridor")
information_10 = ContentInformation(Content=item_4.Item1, Notes=ColourSwatch(SwatchColor=RGB(255, 255, 255)), Tags="service")
information_11 = ContentInformation(Content=item_4.Item, Tags="default")
dmaterial = DeconstructMaterial(Material=information_11)  # -> Diffuse, Specular, Emission, Transparency, Shine
prevclr_5 = PreviewColors(Colors=dmaterial.Diffuse, Height=26, Label=True, Width=100)
m = RemoteSender([information_5, information_6, information_2])
m_2 = RemoteSender([information_8, information_9])
m_3 = RemoteSender([information_3, information_4, information_7, information])
m_4 = RemoteSender([information_11, information_10])
# Pink
number_slider_6 = Slider(2, range=0..10)
# Beige
number_slider_7 = Slider(2, range=0..10)
# Prussian
number_slider_8 = Slider(2, range=0..10)
C_5 = Slider(1, range=0..3)
C_6 = Slider(1, range=0..3)
C_7 = Slider(0, range=0..3)
# Beige
C_8 = Slider(0, range=0..3)
wheel_5 = ColourWheel(
    number_slider_8,
    ColourGrips_Style=10,
    ColourGrips_Grip=[3.974048173, 0.6561438802, 5.368532861, 2.226940207],
    ColourGrips_Lum=[0.3315362293, 0.6669321585],
    ColourGrips_Range=[0.2841923459, 0.2841923459, 0.2841923459, 0.2841923459],
    ColourGrips_Sat=[0.7143009122, 1])
wheel_6 = ColourWheel(
    number_slider_6,
    ColourGrips_Style=10,
    ColourGrips_Grip=[5.295764013, 0.5624644724, 2.656859575, 3.141592654],
    ColourGrips_Lum=[0.6375283928, 0.8516908272],
    ColourGrips_Range=[0.1213420938, 0.1213420938, 0.1213420938, 0.1213420938],
    ColourGrips_Sat=[0.6963567219, 0.6384763019])
wheel_7 = ColourWheel(
    number_slider_7,
    ColourGrips_Style=10,
    ColourGrips_Grip=[0.6347684902, 0.5624644724, 2.656859575, 3.141592654],
    ColourGrips_Lum=[0.6057050521, 0.8351277467],
    ColourGrips_Range=[0.1397221958, 0.1397221958, 0.1397221958, 0.1397221958],
    ColourGrips_Sat=[0.1173350337, 0.5626167831])
cluster_13 = Cluster_3(N="Prussian", A=C_5)
cluster_14 = Cluster_3(N="Beige", A=C_7)
cluster_15 = Cluster_3(N="Lilac", A=C_6)
cluster_16 = Cluster_3(N="Chrome", A=C_8)
cluster_17 = Cluster(C=C_5)
cluster_18 = Cluster(C=C_6)
cluster_19 = Cluster(C=C_7)
cluster_20 = Cluster(C=C_8)
constgrad_5 = ConstructGradient(Colors=wheel_5, Sample=cluster_17, InterpolationMode=0)
cluster_21 = Cluster_2(N=cluster_13, kd=constgrad_5)
constgrad_6 = ConstructGradient(Colors=wheel_6, Sample=cluster_18, InterpolationMode=0)
cluster_22 = Cluster_2(N=cluster_15, kd=constgrad_6)
constgrad_7 = ConstructGradient(Colors=wheel_7, Sample=cluster_19, InterpolationMode=0)
cluster_23 = Cluster_2(N=cluster_14, kd=constgrad_7)
item_5 = ListItem(List=cluster_21, Index=0, Wrap=True)  # -> Item, Item1
constgrad_8 = ConstructGradient(Colors=ColourSwatch(SwatchColor=RGB(255, 221, 84)), Sample=cluster_20, InterpolationMode=0)
cluster_24 = Cluster_2(N=cluster_16, kd=constgrad_8)
item_6 = ListItem(List=cluster_23, Index=0, Wrap=True)  # -> Item, Item1
item_7 = ListItem(List=cluster_22, Index=0, Wrap=True)  # -> Item, Item1
prevclr_6 = PreviewColors(Colors=constgrad_6, Height=100, Label=False, Width=200)
prevclr_7 = PreviewColors(Colors=constgrad_7, Height=100, Label=False, Width=200)
item_8 = ListItem(List=cluster_24, Index=0, Wrap=True)
prevclr_8 = PreviewColors(Colors=constgrad_8, Height=100, Label=False, Width=200)
prevclr_9 = PreviewColors(Colors=constgrad_5, Height=100, Label=False, Width=200)
information_12 = ContentInformation(Content=item_5.Item, Notes=ColourSwatch(SwatchColor=RGB(255, 255, 255)), Tags="lift")
information_13 = ContentInformation(Content=item_5.Item1, Notes=ColourSwatch(SwatchColor=RGB(255, 255, 255)), Tags="staircase")
information_14 = ContentInformation(Content=item_6.Item, Tags="support")
information_15 = ContentInformation(Content=item_7.Item, Tags="clinical")
information_16 = ContentInformation(Content=item_7.Item1, Tags="ot")
information_17 = ContentInformation(Content=item_8, Tags="electrical")
m_5 = RemoteSender([information_12, information_13])
m_6 = RemoteSender(information_14)
m_7 = RemoteSender([information_15, information_16])
# Lavender
number_slider_9 = Slider(2, range=0..10)
m_8 = RemoteSender(information_17)
# Aqua
number_slider_10 = Slider(2, range=0..10)
# dark red
number_slider_11 = Slider(2, range=0..10)
C_9 = Slider(1, range=0..3)
wheel_8 = ColourWheel(
    number_slider_9,
    ColourGrips_Style=10,
    ColourGrips_Grip=[4.632685218, 0.5624644724, 2.656859575, 3.141592654],
    ColourGrips_Lum=[0.7135772148, 0.8725670504],
    ColourGrips_Range=[0.1213420938, 0.1213420938, 0.1213420938, 0.1213420938],
    ColourGrips_Sat=[0.6963567219, 0.6384763019])
C_10 = Slider(0, range=0..3)
wheel_9 = ColourWheel(
    number_slider_10,
    ColourGrips_Style=10,
    ColourGrips_Grip=[2.895030418, 0.5624644724, 2.656859575, 3.141592654],
    ColourGrips_Lum=[0.2899790141, 0.7779269176],
    ColourGrips_Range=[0.08483026211, 0.08483026211, 0.08483026211, 0.08483026211],
    ColourGrips_Sat=[0.3283851903, 0.7325127924])
cluster_25 = Cluster_3(N="Lavender", A=C_9)
cluster_26 = Cluster(C=C_9)
cluster_27 = Cluster_3(N="Aqua", A=C_10)
C_11 = Slider(0, range=0..3)
cluster_28 = Cluster(C=C_10)
constgrad_9 = ConstructGradient(Colors=wheel_8, Sample=cluster_26, InterpolationMode=0)
cluster_29 = Cluster_2(N=cluster_25, kd=constgrad_9)
wheel_10 = ColourWheel(
    number_slider_11,
    ColourGrips_Style=10,
    ColourGrips_Grip=[6.179110926, 0.5624644724, 2.656859575, 3.141592654],
    ColourGrips_Lum=[1, 0],
    ColourGrips_Range=[0.1397221958, 0.1397221958, 0.1397221958, 0.1397221958],
    ColourGrips_Sat=[0, 0])
constgrad_10 = ConstructGradient(Colors=wheel_9, Sample=cluster_28, InterpolationMode=0)
cluster_30 = Cluster_2(N=cluster_27, kd=constgrad_10)
item_9 = ListItem(List=cluster_29, Index=0, Wrap=True)  # -> Item, Item1
prevclr_10 = PreviewColors(Colors=constgrad_9, Height=100, Label=False, Width=200)
cluster_31 = Cluster_3(N="Dark Red", A=C_11)
item_10 = ListItem(List=cluster_30, Index=0, Wrap=True)
cluster_32 = Cluster(C=C_11)
prevclr_11 = PreviewColors(Colors=constgrad_10, Height=100, Label=False, Width=200)
constgrad_11 = ConstructGradient(Colors=ColourSwatch(SwatchColor=RGB(87, 87, 87)), Sample=cluster_32, InterpolationMode=0)
cluster_33 = Cluster_2(N=cluster_31, kd=constgrad_11)
item_11 = ListItem(List=cluster_33, Index=0, Wrap=True)  # -> Item, Item1
information_18 = ContentInformation(Content=item_9.Item1, Tags="fire")
prevclr_12 = PreviewColors(Colors=constgrad_11, Height=100, Label=False, Width=200)
information_19 = ContentInformation(Content=item_10, Tags="opd")
information_20 = ContentInformation(Content=item_9.Item, Tags="plumbing")
m_9 = RemoteSender(information_19)
m_10 = RemoteSender([information_20, information_18])
# Green
number_slider_12 = Slider(2, range=0..10)
information_21 = ContentInformation(Content=item_11.Item, Notes=ColourSwatch(SwatchColor=RGB(0, 0, 0)), Tags="rcc")
m_11 = RemoteSender(information_21)
C_12 = Slider(1, range=0..3)
wheel_11 = ColourWheel(
    number_slider_12,
    ColourGrips_Style=10,
    ColourGrips_Grip=[2.361297729, 0.5624644724, 2.656859575, 3.141592654],
    ColourGrips_Lum=[0.4253187726, 0.8400310574],
    ColourGrips_Range=[0.1397221958, 0.1397221958, 0.1397221958, 0.1397221958],
    ColourGrips_Sat=[0.189796709, 0.6363759994])
cluster_34 = Cluster(C=C_12)
cluster_35 = Cluster_3(N="Green", A=C_12)
constgrad_12 = ConstructGradient(Colors=wheel_11, Sample=cluster_34, InterpolationMode=0)
cluster_36 = Cluster_2(N=cluster_35, kd=constgrad_12)
prevclr_13 = PreviewColors(Colors=constgrad_12, Height=100, Label=False, Width=200)
item_12 = ListItem(List=cluster_36, Index=0, Wrap=True)  # -> Item, Item1
information_22 = ContentInformation(Content=item_12.Item1, Tags="toilet")
information_23 = ContentInformation(Content=item_12.Item, Tags="hvac")
m_12 = RemoteSender([information_23, information_22])
m_13 = RemoteReceiver([m_4, m_3, m_6, m, m_7, m_10, m_2, m_5, m_9, m_12, m_11, m_8])
information_24 = ContentInformation(Content=m_13)  # -> Content, Notes, Tags
combine = CombineData(Input0=information_24.Notes, Input1=ColourSwatch(SwatchColor=RGB(0, 0, 0)))  # -> Result, Index
information_25 = ContentInformation(Content=information_24.Content, Notes=combine.Result)  # -> Content, Name, Notes, Tags
remote_sender = RemoteSender(information_25.Content)
remote_receiver = RemoteReceiver(remote_sender)
remote_receiver_2 = RemoteReceiver(remote_sender)
lng = ListLength(List=remote_receiver)
information_26 = ContentInformation(Content=remote_receiver_2)  # -> Content, Notes, Tags
split = SplitList(List=arrrec.Geometry, Index=lng)  # -> ListA, ListB
area = Area(Geometry=split.ListA)
join = TextJoin(Text=information_26.Tags)
curve_preview = CustomCurvePreview(Curve=split.ListA, Linetype=qltype, Colour=ColourSwatch(SwatchColor=RGB(0, 0, 0)))
boundary = BoundarySurfaces(Edges=split.ListA)
text = TextEntity(Plane=graft(area), Text=join, TextSettings=as_text)
mesh = MeshBrep(Brep=boundary, Settings=jagged)
remote_receiver_3 = RemoteReceiver(remote_sender)
dmaterial_2 = DeconstructMaterial(Material=information_25.Content)  # -> Diffuse, Specular, Emission, Transparency, Shine
kwire = KikeWirePreview(Geometry=text, Color=graft(information_26.Notes))  # inputs Color: Color, Thickness: Int32
# ---------- kwire: C# ----------
// Grasshopper Script Instance
#region Usings
using System;
using System.Linq;
using System.Collections;
using System.Collections.Generic;
using System.Drawing;

using Rhino;
using Rhino.Geometry;

using Grasshopper;
using Grasshopper.Kernel;
using Grasshopper.Kernel.Data;
using Grasshopper.Kernel.Types;
using Grasshopper.Rhinoceros.Model;
#endregion

public class Script_Instance : GH_ScriptInstance
{
    #region Notes
    /* 
      Members:
        RhinoDoc RhinoDocument
        GH_Document GrasshopperDocument
        IGH_Component Component
        int Iteration

      Methods (Virtual & overridable):
        Print(string text)
        Print(string format, params object[] args)
        Reflect(object obj)
        Reflect(object obj, string method_name)
    */
    #endregion

    List<(ModelObject Object, Color Color, int Thickness)> Objects = new List<(ModelObject, Color, int)>();
    BoundingBox _ClippingBox = BoundingBox.Empty;

    private void RunScript(object Geometry, Color Color, int Thickness)
    {
        if (ModelObject.Cast(Geometry) is ModelObject obj)
        {
            _ClippingBox.Union(obj.BoundingBox);
            Objects.Add((obj, Color, Thickness));
        }
    }

    public override void BeforeRunScript()
    {
        Objects.Clear();
        _ClippingBox = BoundingBox.Empty;
    }

    public override void AfterRunScript() { }

    public override BoundingBox ClippingBox => _ClippingBox;

    public override void DrawViewportWires(IGH_PreviewArgs args)
    {
        foreach(var obj in Objects)
        {
            var a = new GH_PreviewWireArgs
            (
                args.Viewport,
                args.Display,
                Component.Attributes.Selected ? args.WireColour_Selected : 
                obj.Color.IsEmpty ? args.WireColour : obj.Color,
                obj.Thickness == 0 ? args.DefaultCurveThickness : obj.Thickness
            );

            if (a.Thickness < 1) continue;
            (obj.Object as IGH_PreviewData).DrawViewportWires(a);
        }
    }
}
# ---------- end kwire ----------
preview = CustomPreview(Geometry=mesh, Material=remote_receiver_3)
entwine = Entwine(Branch00=information_25.Tags, Branch01=dmaterial_2.Diffuse, Branch02=information_25.Notes, FlattenInputs=True)
flip = FlipMatrix(Data=entwine)
join_2 = TextJoin(Text=flip, Join="$")  # -> flatten(Result)
merge = Merge(Data1=flatten("name$bg_colour$txt_colour"), Data2=flatten(join_2))
prevclr_14 = PreviewColors(Colors=dmaterial_2.Diffuse, Height=33, Label=True, Width=165)
panel = Panel(merge)

# ==== cluster Cluster
C = ClusterInput()
div = DivideDomain(Domain=Domain(0, 1), Count=C)
num = Number(div)
ma = MassAddition(Input=num)  # -> Result, PartialResults
merge = Merge(Data1=graft("0"), Data2=ma.PartialResults)
R = ClusterOutput(merge)

# ==== cluster Cluster_2
kd = ClusterInput()
material = CreateMaterial(Diffuse=kd, Specular=RGB(255, 255, 255), Emission=RGB(0, 0, 0), Transparency=0, Shine=0)
N = ClusterInput()
material_2 = ModelMaterial(Name=N, Shader=material)
M = ClusterOutput(material_2)

# ==== cluster Cluster_3
A = ClusterInput()
addition = Addition(A=A, B=1)
series = Series(Start=1, Step=1, Count=addition)
N = ClusterInput()
concat = Concatenate(FragmentA=N, FragmentB=series)
R = ClusterOutput(concat)

# ==== cluster QLtype: qLtype
S = ClusterInput()
W = ClusterInput()
S_2 = Integer(S)
W_2 = Integer(W)
concat = Concatenate(FragmentA="q", FragmentB=S_2, FragmentC="s", FragmentD=W_2, FragmentE="w")
division = Division(A=S_2, B=2)
neg = Negative(Value=division)
merge = Merge(Data1=division, Data2=neg)
linetype = ModelLinetype(Name=concat, Segments=merge, Width=W_2, WidthUnits=0)
L = ClusterOutput(linetype)
